% Simulink data dictionary Time.sldd

second = Simulink.ValueType(DataType="uint8", be=Simulink.BusElement(Name="a", DataType="double"))
minute = Simulink.ValueType(DataType="uint8", be=Simulink.BusElement(Name="a", DataType="double"))
hour = Simulink.ValueType(DataType="uint8", be=Simulink.BusElement(Name="a", DataType="double"))
day = Simulink.ValueType(DataType="uint8", be=Simulink.BusElement(Name="a", DataType="double"))
Sig = Simulink.Signal(DataType="Bus: Time")

Time = Simulink.Bus()
  day: uint8
  minute: uint8
  second: uint8
  hour: uint8